# Grasshopper definition wave.gh (Grasshopper 1.0.6)
# plug-ins: MosquitoAudio2

number_slider = Slider(0.25, range=0..1)
path = FilePath("F:\vyriyang-poetry-generator\The_flowers_of_Evil owl.mp3")
audiowave = AudioWave(AudioFile=path, XOffset=Slider(0.25, range=0..1))  # -> Peak, Points, Length
play = AudioPlay(AudioFile=path, Boolean=Toggle(False))
